# Grasshopper definition JWL1005_stl_subdefinition.gh (Grasshopper 1.0.7)
# plug-ins: Jewlr

text_height = Slider(2, range=0..2)
adjust = Slider(1.437, range=-2..2)
number_slider = Slider(1, range=0..2)
get_number = GetNumber(AtLeast=0, AtMost=1, Maximum=1.797693135e+308, Minimum=-1.797693135e+308)
get_string = GetString(AtLeast=0, AtMost=1)
num = Number(text_height)
num_2 = Number(get_number)
txt = Text(get_string)

# ---- group: Alternative method for font sizing
chars = Characters(Text=txt)  # -> Result, Unicode
lng = ListLength(List=chars.Result)
division = Division(A="3", B=lng)
graph = GraphMapper(division, x0=0, x1=3, y0=0, y1=3, container_name="Bezier", cpx=[0, 0.1271738261, 0.2195651233, 1], cpy=[0, 0, 1, 1])
addition = Addition(A=graph, B="5.2")
font_size = Panel(addition)

# ---- group: Create Ring Profile / Ring Profile Curves
crv = Curve(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)
crv_2 = Curve(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)
crv_3 = Curve(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)

# ---- group: Create Text
italics = BooleanToggle(False)
bold = BooleanToggle(False)
txt_2 = TextSurfaces(
    Text=txt,
    Plane=PlaneXY(0, 0, 0),
    Font="GlamorousGrasshopper",
    Bold=bold,
    Italics=italics,
    Size=addition,
    Kerning=Slider(-0.028, range=-0.25..0.25))

# ----
working_width = Slider(22.5, range=0..30)

# ---- group: Scale surfaces if they are wider than working width
bbox = BoundingBox(Content=txt_2, Plane=PlaneXY(0, 0, 0), UnionBox=True)  # -> Box, Box_2
dim = Dimensions(Surface=bbox.Box)  # -> UDimension, VDimension
area = Area(Geometry=bbox.Box)  # -> Area, Centroid
width = Panel(dim.UDimension)
larger = LargerThan(FirstNumber=dim.UDimension, SecondNumber=working_width)  # -> LargerThan, OrEqualTo
division_2 = Division(A=working_width, B=dim.UDimension)
filter = StreamFilter(Gate=larger.LargerThan, Stream0="1.0", Stream1=division_2)
scale = Scale(Geometry=txt_2, Center=area.Centroid, Factor=filter)  # -> Geometry, Transform

# ---- group: Deform Text
t0 = Slider(0, range=0..1)
t1 = Slider(0.5, range=0..1)
xz = XZPlane(Origin=Point(0, 0, 0))
cir = Circle(Plane=xz, Radius=num_2)
dom = ConstructDomain(DomainStart=t0, DomainEnd=t1)
subcrv = SubCurve(BaseCurve=reparameterize(cir), Domain=dom)  # -> graft(Curve)
edge_index = Slider(1, range=0..11)
bbox_2 = BoundingBox(Content=scale.Geometry, Plane=PlaneXY(0, 0, 0), UnionBox=True)  # -> Box, Box_2
edges = BrepEdges(Brep=bbox_2.Box)  # -> Naked, Interior, NonManifold
item = ListItem(List=edges.Naked, Index=edge_index, Wrap=True)
item_2 = ListItem(List=edges.Naked, Index=0, Wrap=True)
midpt = CurveMiddle(Curve=item)
len = Length(Curve=item_2)
division_3 = Division(A=len, B=2)
pdecon = Deconstruct(Point=midpt)  # -> XComponent, YComponent, ZComponent
subtraction = Subtraction(A=num_2, B=pdecon.XComponent)
end = EndPoints(Curve=subcrv)  # -> Start, End
eval = EvaluateLength(Curve=subcrv, Length=division_3, Normalized=False)  # -> Point, Tangent, Parameter
offset = Panel("0.5")
X = UnitX(Factor=subtraction)
addition_2 = Addition(A=num, B=offset)
move = Move(Geometry=scale.Geometry, Motion=X)  # -> Geometry, Transform
Y = UnitY(Factor=1)
rot3d = Rotate3D(Geometry=graft(move.Geometry), Angle=1.570796327, Center=end.Start, Axis=Y)  # -> Geometry, Transform
X_2 = UnitX(Factor=expr("-x", offset))
X_3 = UnitX(Factor=[num, addition_2])
move_2 = Move(Geometry=rot3d.Geometry, Motion=X_2)  # -> Geometry, Transform
extr = Extrude(Base=[rot3d.Geometry, move_2.Geometry], Direction=X_3)
flip = FlipMatrix(Data=extr)
bend = BendDeform(Geometry=flip, BendingArc=subcrv)
pt = ConstructPoint(XCoordinate=0, YCoordinate=0, ZCoordinate=0)
vec2pt = Vector2Pt(PointA=pt, PointB=eval.Point, Unitize=False)  # -> Vector, Length
Z = UnitZ(Factor=1)
angle = Angle(VectorA=vec2pt.Vector, VectorB=Z)  # -> Angle, Reflex
Y_2 = UnitY(Factor=1)
rot3d_2 = Rotate3D(Geometry=bend, Angle=expr("-x", angle.Angle), Center=Point(0, 0, 0), Axis=Y_2)  # -> Geometry, Transform
bang = ExplodeTree(Data=rot3d_2.Geometry)  # -> Branch0, Branch1

# ----
Y_3 = UnitY(Factor=adjust)

# ---- group: For Trim
move_3 = Move(Geometry=bang.Branch1, Motion=Y_3)  # -> Geometry, Transform

# ---- group: Deformed Text
move_4 = Move(Geometry=bang.Branch0, Motion=Y_3)  # -> Geometry, Transform

# ----
bbox_3 = BoundingBox(Content=move_4.Geometry, Plane=PlaneXY(0, 0, 0), UnionBox=True)  # -> Box, Box_2
debrep = DeconstructBrep(Brep=bbox_3.Box)  # -> Faces, Edges, Vertices
item_3 = ListItem(List=debrep.Faces, Index=Slider(5, range=0..10), Wrap=True)
pt_2 = Point(Point(0, 0, 0))
area_2 = Area(Geometry=item_3)  # -> Area, Centroid
ln = Line(StartPoint=area_2.Centroid, EndPoint=pt_2)
devec = DeconstructVector(Vector=ln)  # -> XComponent, YComponent, ZComponent
division_4 = Division(A=devec.YComponent, B=Slider(2.543, range=0..10))
Y_4 = UnitY(Factor=division_4)
move_5 = Move(Geometry=move_3.Geometry, Motion=Y_4)  # -> Geometry, Transform
neg = Negative(Value=devec.YComponent)

# ---- group: Trim Text From Profile / First letter
item_4 = ListItem(List=move_5.Geometry, Index=0, Wrap=True)

# ---- group: Trim Text From Profile / Last letter
item_5 = ListItem(List=move_5.Geometry, Index=-1, Wrap=True)

# ----
addition_3 = Addition(A=num_2, B=Slider(1, range=0..10))
Z_2 = UnitZ(Factor=addition_3)
move_6 = Move(Geometry=move_4.Geometry, Motion=Y_4)  # -> Geometry, Transform
geo = Geometry(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)
neg_2 = Negative(Value=Z_2)
mesh = Mesh(geo)
move_7 = Move(Geometry=mesh, Motion=neg_2)  # -> Geometry, Transform

# ---- group: Create Ring Profile
xz_2 = XZPlane(Origin=Point(0, 0, 0))
# This method will scale the font so that it
# always falls between 5.0 and 8.0 no matter
# the length of the name that is used.
cir_2 = Circle(Plane=xz_2, Radius=num_2)
xy = XYPlane(Origin=Point(0, 0, 0))
mirror = Mirror(Geometry=crv_2, Plane=xy)  # -> Geometry, Transform
Y_5 = UnitY(Factor=Slider(0.416, range=0..1))
Z_3 = UnitZ(Factor=expr("-x", num_2))
pt_3 = ConstructPoint(XCoordinate=0, YCoordinate=0, ZCoordinate=0)
line = LineSDL(Start=pt_3, Direction=Vector(0, 0, 1), Length=1)
move_8 = Move(Geometry=mirror.Geometry, Motion=Y_5)  # -> Geometry, Transform
move_9 = Move(Geometry=crv_2, Motion=Z_3)  # -> Geometry, Transform
move_10 = Move(Geometry=crv_3, Motion=Z_3)  # -> Geometry, Transform
join = JoinCurves(Curves=[move_9.Geometry, move_10.Geometry], Preserve=False)
Y_6 = UnitY(Factor=expr("-x", 1))
clx = CurveLine(Curve=move_8.Geometry, Line=line)  # -> Points, Params, Count
shatter = Shatter(Curve=move_8.Geometry, Parameters=clx.Params)
rot3d_3 = Rotate3D(Geometry=move_9.Geometry, Angle=1.570796327, Center=Point(0, 0, 0), Axis=Y_6)  # -> Geometry, Transform
item_6 = ListItem(List=shatter, Index=0, Wrap=True)
end_2 = EndPoints(Curve=rot3d_3.Geometry)  # -> Start, End
ext = ExtendCurve(Curve=item_6, Type=0, Start="0.176649", End=0)
xz_3 = XZPlane(Origin=Point(0, 0, 0))
yz = YZPlane(Origin=end_2.Start)
mirror_2 = Mirror(Geometry=rot3d_3.Geometry, Plane=yz)  # -> Geometry, Transform
mirror_3 = Mirror(Geometry=ext, Plane=xz_3)  # -> Geometry, Transform
join_2 = JoinCurves(Curves=[mirror_2.Geometry, rot3d_3.Geometry], Preserve=False)
join_3 = JoinCurves(Curves=[ext, mirror_3.Geometry], Preserve=False)
end_3 = EndPoints(Curve=join_3)  # -> Start, End
mirror_4 = Mirror(Geometry=join_2, Plane=PlaneYZ(0, 0, 0))  # -> Geometry, Transform
xy_2 = XYPlane(Origin=end_3.End)
area_3 = Area(Geometry=mirror_4.Geometry)  # -> Area, Centroid
area_4 = Area(Geometry=join_2)  # -> Area, Centroid
mirror_5 = Mirror(Geometry=join_3, Plane=xy_2)  # -> Geometry, Transform
yz_2 = YZPlane(Origin=area_3.Centroid)
yz_3 = YZPlane(Origin=area_4.Centroid)
join_4 = JoinCurves(Curves=[join_3, mirror_5.Geometry], Preserve=False)
Z_4 = UnitZ(Factor=num_2)
mirror_6 = Mirror(Geometry=mirror_4.Geometry, Plane=yz_2)  # -> Geometry, Transform
mirror_7 = Mirror(Geometry=join_2, Plane=yz_3)  # -> Geometry, Transform
move_11 = Move(Geometry=join_4, Motion=Z_4)  # -> Geometry, Transform

# ---- group: Create Ring Profile / Guide curves
flatten = FlattenTree(Tree=[mirror_7.Geometry, move_11.Geometry, mirror_6.Geometry, join], Path="{0}")

# ---- group: Create Ring Profile (continued)
swp1 = Sweep1(Rail=cir_2, Sections=flatten, Miter=2)

# ---- group: Trim Text From Profile
bbox_4 = BoundingBox(Content=move_3.Geometry, Plane=PlaneXY(0, 0, 0), UnionBox=True)  # -> Box, Box_2
wires = BrepWireframe(Brep=bbox_4.Box, Density=-1)
item_7 = ListItem(List=wires, Index=1, Wrap=True)
item_8 = ListItem(List=wires, Index=9, Wrap=True)
len_2 = Length(Curve=item_8)
X_4 = UnitX(Factor=Slider(0.375, range=0..1))
move_12 = Move(Geometry=item_7, Motion=X_4)  # -> Geometry, Transform
xz_4 = XZPlane(Origin=Point(0, 0, 0))
plx = LinePlane(Line=move_12.Geometry, Plane=xz_4)  # -> Point, ParamL, ParamP
Y_7 = UnitY(Factor=Slider(0.375, range=0..1))
move_13 = Move(Geometry=plx.Point, Motion=expr("-x", Y_7))  # -> Geometry, Transform
move_14 = Move(Geometry=plx.Point, Motion=Y_7)  # -> Geometry, Transform
yz_4 = YZPlane(Origin=Point(0, 0, 0))
ln_2 = Line(StartPoint=move_14.Geometry, EndPoint=move_13.Geometry)
project = Project(Geometry=ln_2, Plane=yz_4)  # -> Geometry, Transform
ext_2 = ExtendCurve(Curve=project.Geometry, Type=0, Start=number_slider, End=number_slider)
Z_5 = UnitZ(Factor=expr("x+1", len_2))

# ----
end_4 = EndPoints(Curve=ln_2)  # -> Start, End
end_5 = EndPoints(Curve=ext_2)  # -> Start, End
srf4pt = _4PointSurface(CornerA=end_5.Start, CornerB=end_5.End, CornerC=end_4.End, CornerD=end_4.Start)

# ---- group: Trim Text From Profile (continued)
mirror_8 = Mirror(Geometry=srf4pt, Plane=PlaneYZ(0, 0, 0))  # -> Geometry, Transform
join_5 = BrepJoin(Breps=[srf4pt, mirror_8.Geometry])  # -> Breps, Closed
extr_2 = Extrude(Base=join_5.Breps, Direction=Z_5)
sdiff = SolidDifference(BrepsA=swp1, BrepsB=extr_2)
sdiff_2 = SolidDifference(BrepsA=flatten(sdiff), BrepsB=flatten([item_4, item_5]))
area_5 = Area(Geometry=sdiff_2)  # -> Area, Centroid
sort = SortList(Keys=area_5.Area, ValuesA=sdiff_2)  # -> Keys, ValuesA
item_9 = ListItem(List=sort.ValuesA, Index=-1, Wrap=True)

# ---- group: Convert Brep to Mesh
jagged = SettingsSpeed()
mesh_2 = MeshBrep(Brep=[move_6.Geometry, item_9], Settings=jagged)

# ----
flatten_2 = FlattenTree(Tree=mesh_2, Path="{0}")
mjoin = MeshJoin(Meshes=[flatten_2, move_7.Geometry])
context_bake = ContextBake(Geometry=mjoin)
