# Grasshopper definition master-hops-JWL1005.gh (Grasshopper 1.0.7)
# plug-ins: Hops

# ---- group: RH_IN:size
num = Number()

# ---- group: RH_IN:e1
txt = Text()

# ----
hops = Hops(
    GetString=txt,
    GetNumber=num,
    CacheResultsInMemory=False,
    CacheSolveResults=False,
    RemoteDefinitionLocation="C:\Users\ContainerAdministrator\Config\JWL1005_stl.gh",
    RemoteSolveVersion=(0, 1, 0),
    ShowInput_Enabled=False,
    ShowInput_Path=False,
    SynchronousSolve=True)

# ---- group: RH_OUT:mesh
mesh = Mesh(hops)
